# Grasshopper definition boxes.gh (Grasshopper 1.0.7)

pt = Point(Point(-100, -100, -100))
pt_2 = Point(Point(100, 100, 100))
box = Box2Pt(PointA=pt_2, PointB=pt, Plane=PlaneXY(0, 0, 0))  # -> graft(Box)
panel = Panel("""1
0
0
0
0
1
0
0
0
0
1
203
0
0
0
1""")
panel_2 = Panel("""1
0
0
120
0
1
0
0
0
0
1
500
0
0
0
1""")
panel_3 = Panel("""1
0
0
0
0
1
0
150
0
0
1
1200
0
0
0
1""")
mass = Slider(1, range=0..15)
int = Integer(4)
int_2 = Integer(4)
int_3 = Integer(4)
matrix = ConstructMatrix(Rows=int, Columns=int, Values=panel)
matrix_2 = ConstructMatrix(Rows=int_2, Columns=int_2, Values=panel_2)
matrix_3 = ConstructMatrix(Rows=int_3, Columns=int_3, Values=panel_3)
matrix_4 = DisplayMatrix(matrix)
matrix_5 = DisplayMatrix(matrix_2)
matrix_6 = DisplayMatrix(matrix_3)
physicalobjecttype = CreatePhysicalObjectType(name="box", convex_geometries=box, mass_kg=mass)  # -> physical_object_type; inputs convex_geometries: list of Mesh
# ---------- physicalobjecttype: Python ----------
# MIT License
#
# Copyright (c) 2020 Tim Schneider
#
# Permission is hereby granted, free of charge, to any person obtaining a copy
# of this software and associated documentation files (the "Software"), to deal
# in the Software without restriction, including without limitation the rights
# to use, copy, modify, merge, publish, distribute, sublicense, and/or sell
# copies of the Software, and to permit persons to whom the Software is
# furnished to do so, subject to the following conditions:
#
# The above copyright notice and this permission notice shall be included in all
# copies or substantial portions of the Software.
#
# THE SOFTWARE IS PROVIDED "AS IS", WITHOUT WARRANTY OF ANY KIND, EXPRESS OR
# IMPLIED, INCLUDING BUT NOT LIMITED TO THE WARRANTIES OF MERCHANTABILITY,
# FITNESS FOR A PARTICULAR PURPOSE AND NONINFRINGEMENT. IN NO EVENT SHALL THE
# AUTHORS OR COPYRIGHT HOLDERS BE LIABLE FOR ANY CLAIM, DAMAGES OR OTHER
# LIABILITY, WHETHER IN AN ACTION OF CONTRACT, TORT OR OTHERWISE, ARISING FROM,
# OUT OF OR IN CONNECTION WITH THE SOFTWARE OR THE USE OR OTHER DEALINGS IN THE
# SOFTWARE.

"""Creates a type of physical object for simulation.
    Inputs:
        name:               Name of this physical object type.
        convex_geometries:  Convex geometric shapes this physical object type 
                            consists of. Note that using non-convex geometric
                            shapes is generally possible but might result in an
                            unstable stable simulation. Instead, decompose any
                            geometric shapeinto multiple convex shapes before 
                            using it in the simulation.
        mass_kg:            Mass of this physical object type in kg (default 
                            1kg).
        lateral friction:   Friction of this object sliding over another object.
        spinning friction:  Friction of this object spinning on another object
                            (e.g. a top spinning on a table).
        rolling friction:   Friction of an object rolling over another object 
                            (e.g. a wheel rolling over the ground).
                            For details on how to set these values, please refer
                            to the documentation of the bullet physics engine.
    Output:
        physical_object_type: A physical object type."""
        
__author__ = "Tim Schneider"
__version__ = "2020.10.12"
        
import rhinoscriptsyntax as rs
import Grasshopper as gh
        
import sys
        
ghcompfolder = gh.Folders.DefaultAssemblyFolder
ghsim_path = ghcompfolder + "ghsim"
if ghsim_path not in sys.path:
    sys.path.append(ghsim_path)
try:
    import ghsim
except:
    ghenv.Component.AddRuntimeMessage(gh.Kernel.GH_RuntimeMessageLevel.Error, 
        "Cannot import ghsim. Please ensure that the ghsim.py "
        "module is installed in \"{}\".".format(ghsim_path))
    ghsim = None

if ghsim:
    ok = True
    if name is None:
        ok = False
        ghsim.log_error(ghenv, "The \"name\" parameter must not be empty.")
    if convex_geometries is None:
        ok = False
        ghsim.log_error(ghenv, 
            "The \"convex_geometries\" parameter must not be empty.")
    if mass_kg is None:
        mass_kg = 1.0
    dynamics = {}
    if lateral_friction is not None:
        dynamics["lateralFriction"] = lateral_friction
    if spinning_friction is not None:
        dynamics["spinningFriction"] = spinning_friction
    if rolling_friction is not None:
        dynamics["rollingFriction"] = rolling_friction

if ok:
    physical_object_type = ghsim.PhysicalObjectType(name, convex_geometries,
        mass_kg, dynamics)
# ---------- end physicalobjecttype ----------
transform = Transform(matrix_4)
transform_2 = Transform(matrix_5)
transform_3 = Transform(matrix_6)
physicalobject = CreatePhysicalObject(physical_object_type=physicalobjecttype, transformation=[transform, transform_2, transform_3])  # -> physical_object
# ---------- physicalobject: Python ----------
# MIT License
#
# Copyright (c) 2020 Tim Schneider
#
# Permission is hereby granted, free of charge, to any person obtaining a copy
# of this software and associated documentation files (the "Software"), to deal
# in the Software without restriction, including without limitation the rights
# to use, copy, modify, merge, publish, distribute, sublicense, and/or sell
# copies of the Software, and to permit persons to whom the Software is
# furnished to do so, subject to the following conditions:
#
# The above copyright notice and this permission notice shall be included in all
# copies or substantial portions of the Software.
#
# THE SOFTWARE IS PROVIDED "AS IS", WITHOUT WARRANTY OF ANY KIND, EXPRESS OR
# IMPLIED, INCLUDING BUT NOT LIMITED TO THE WARRANTIES OF MERCHANTABILITY,
# FITNESS FOR A PARTICULAR PURPOSE AND NONINFRINGEMENT. IN NO EVENT SHALL THE
# AUTHORS OR COPYRIGHT HOLDERS BE LIABLE FOR ANY CLAIM, DAMAGES OR OTHER
# LIABILITY, WHETHER IN AN ACTION OF CONTRACT, TORT OR OTHERWISE, ARISING FROM,
# OUT OF OR IN CONNECTION WITH THE SOFTWARE OR THE USE OR OTHER DEALINGS IN THE
# SOFTWARE.

"""Creates a physical object for the simulation.
    Inputs:
        physical_object_type:   Type of the physical object to create.
        transformation:         Transformation of the physical object in the
                                world.
    Output:
        physical_object: The physical object."""

__author__ = "Tim Schneider"
__version__ = "2020.10.12"

import rhinoscriptsyntax as rs
import Grasshopper as gh

import sys

ghcompfolder = gh.Folders.DefaultAssemblyFolder
ghsim_path = ghcompfolder + "ghsim"
if ghsim_path not in sys.path:
    sys.path.append(ghsim_path)
try:
    import ghsim
except:
    ghenv.Component.AddRuntimeMessage(gh.Kernel.GH_RuntimeMessageLevel.Error, 
        "Cannot import ghsim. Please ensure that the ghsim.py "
        "module is installed in \"{}\".".format(ghsim_path))
    ghsim = None

if ghsim:
    ok = True
    if physical_object_type is None:
        ok = False
        ghsim.log_error(ghenv, 
            "The \"physical_object_type\" parameter must not be empty.")
    if transformation is None:
        ok = False
        ghsim.log_error(ghenv, 
            "The \"transformation\" parameter must not be empty.")
    
    if ok:
        physical_object = ghsim.PhysicalObject(
            physical_object_type, transformation)
# ---------- end physicalobject ----------
ground_plane_pos = Slider(0, range=-1000..1000)
simulation_time_step_s = Slider(0.1, range=0.001..0.5)
int_4 = Integer(20)
externalsimulator = CreateExternalSimulatorConfig(hostname="localhost", port="8000")  # -> simulator
# ---------- externalsimulator: Python ----------
# MIT License
#
# Copyright (c) 2020 Tim Schneider
#
# Permission is hereby granted, free of charge, to any person obtaining a copy
# of this software and associated documentation files (the "Software"), to deal
# in the Software without restriction, including without limitation the rights
# to use, copy, modify, merge, publish, distribute, sublicense, and/or sell
# copies of the Software, and to permit persons to whom the Software is
# furnished to do so, subject to the following conditions:
#
# The above copyright notice and this permission notice shall be included in all
# copies or substantial portions of the Software.
#
# THE SOFTWARE IS PROVIDED "AS IS", WITHOUT WARRANTY OF ANY KIND, EXPRESS OR
# IMPLIED, INCLUDING BUT NOT LIMITED TO THE WARRANTIES OF MERCHANTABILITY,
# FITNESS FOR A PARTICULAR PURPOSE AND NONINFRINGEMENT. IN NO EVENT SHALL THE
# AUTHORS OR COPYRIGHT HOLDERS BE LIABLE FOR ANY CLAIM, DAMAGES OR OTHER
# LIABILITY, WHETHER IN AN ACTION OF CONTRACT, TORT OR OTHERWISE, ARISING FROM,
# OUT OF OR IN CONNECTION WITH THE SOFTWARE OR THE USE OR OTHER DEALINGS IN THE
# SOFTWARE.

"""Creates a simulator configuration for an external simulator.
    Inputs:
        hostname:   The hostname of the external simulator (default: localhost).
        port:       The port of the external simulator (default: 8000).
    Output:
        simulator: The simulator configuration."""

__author__ = "Tim Schneider"
__version__ = "2020.10.12"

import rhinoscriptsyntax as rs
import Grasshopper as gh

import sys

ghcompfolder = gh.Folders.DefaultAssemblyFolder
ghsim_path = ghcompfolder + "ghsim"
if ghsim_path not in sys.path:
    sys.path.append(ghsim_path)
try:
    import ghsim
except:
    ghenv.Component.AddRuntimeMessage(gh.Kernel.GH_RuntimeMessageLevel.Error, 
        "Cannot import ghsim. Please ensure that the ghsim.py "
        "module is installed in \"{}\".".format(ghsim_path))
    ghsim = None

if ghsim:
    if hostname is None:
        hostname = "localhost"
    if port is None:
        port = 8000
    
    simulator = ghsim.Simulator(hostname, int(port))
# ---------- end externalsimulator ----------
panel_4 = Panel(int_4)
simulation = Simulation(
    physical_objects=physicalobject,
    simulator=externalsimulator,
    enabled=Toggle(True),
    simulation_time_s=Slider(3, range=0..15),
    simulation_time_step_s=simulation_time_step_s,
    simulation_substeps=panel_4,
    ground_plane_pos=ground_plane_pos)  # -> simulation_result; inputs physical_objects: list, simulation_substeps: Int32
# ---------- simulation: Python ----------
# MIT License
#
# Copyright (c) 2020 Tim Schneider
#
# Permission is hereby granted, free of charge, to any person obtaining a copy
# of this software and associated documentation files (the "Software"), to deal
# in the Software without restriction, including without limitation the rights
# to use, copy, modify, merge, publish, distribute, sublicense, and/or sell
# copies of the Software, and to permit persons to whom the Software is
# furnished to do so, subject to the following conditions:
#
# The above copyright notice and this permission notice shall be included in all
# copies or substantial portions of the Software.
#
# THE SOFTWARE IS PROVIDED "AS IS", WITHOUT WARRANTY OF ANY KIND, EXPRESS OR
# IMPLIED, INCLUDING BUT NOT LIMITED TO THE WARRANTIES OF MERCHANTABILITY,
# FITNESS FOR A PARTICULAR PURPOSE AND NONINFRINGEMENT. IN NO EVENT SHALL THE
# AUTHORS OR COPYRIGHT HOLDERS BE LIABLE FOR ANY CLAIM, DAMAGES OR OTHER
# LIABILITY, WHETHER IN AN ACTION OF CONTRACT, TORT OR OTHERWISE, ARISING FROM,
# OUT OF OR IN CONNECTION WITH THE SOFTWARE OR THE USE OR OTHER DEALINGS IN THE
# SOFTWARE.

"""Simulates the behavior of the given physical objects.
    Inputs:
        physical_objects:       The physical objects to simulate.
        simulator:              The simulator configuration.
        enabled:                Set this to false to disable the simulation.
        simulation_time_s:      Total time of the simulation in seconds (default
                                10s).
        simulation_time_step_s: Time step of the simulator in seconds (default
                                0.1s).
        real_time_factor:       Real time factor of the simulation. Setting e.g.
                                0.5 here will cause the simulation to run in
                                half of real time speed. Note that this
                                parameter is ignored if the simulation server
                                was not launched with the "-v" flag.
        simulation_substeps:    Further subdivide the simulator steps by this
                                number (default 20). This will trade performance
                                over accuracy.
        ground_plane_pos:       Position of the ground plane (z coordinates)
                                (default: lowest point of all meshes -3mm).
    Output:
        simulation_result:  The results of the simulation as a list of 
                            simulation states (one for each time step)."""

__author__ = "Tim Schneider"
__version__ = "2020.10.12"

import rhinoscriptsyntax as rs
import Grasshopper as gh

import sys

ghcompfolder = gh.Folders.DefaultAssemblyFolder
ghsim_path = ghcompfolder + "ghsim"
if ghsim_path not in sys.path:
    sys.path.append(ghsim_path)
try:
    import ghsim
except:
    ghenv.Component.AddRuntimeMessage(gh.Kernel.GH_RuntimeMessageLevel.Error, 
        "Cannot import ghsim. Please ensure that the ghsim.py "
        "module is installed in \"{}\".".format(ghsim_path))
    ghsim = None

if ghsim:
    if enabled:
        ok = True
        if simulation_time_s is None:
            simulation_time_s = 5.0
        if simulation_time_step_s is None:
            simulation_time_step_s = 0.1
        if simulation_substeps is None:
            simulation_substeps = 20
        if physical_objects is None:
            ok = False
            ghsim.log_error(ghenv, 
                "The \"physical_objects\" parameter must not be empty.")
        if simulator is None:
            ok = False
            ghsim.log_error(ghenv, "The \"simulator\" parameter must not be empty.")
        if ok:
            try:
                with ghsim.SimulatorConnection(simulator) as conn:
                    simulation_result = conn.simulate(physical_objects, 
                        simulation_time_s, simulation_time_step_s, 
                        simulation_substeps, real_time_factor, ground_plane_pos)
            except Exception as e:
                ghsim.log_error(ghenv, str(e))
# ---------- end simulation ----------
time_s = Slider(0, range=0..3)
simulationstateat = RetrieveSimulationStateAt(simulation_results=simulation, time_s=time_s)  # -> simulation_state; inputs simulation_results: list
# ---------- simulationstateat: Python ----------
# MIT License
#
# Copyright (c) 2020 Tim Schneider
#
# Permission is hereby granted, free of charge, to any person obtaining a copy
# of this software and associated documentation files (the "Software"), to deal
# in the Software without restriction, including without limitation the rights
# to use, copy, modify, merge, publish, distribute, sublicense, and/or sell
# copies of the Software, and to permit persons to whom the Software is
# furnished to do so, subject to the following conditions:
#
# The above copyright notice and this permission notice shall be included in all
# copies or substantial portions of the Software.
#
# THE SOFTWARE IS PROVIDED "AS IS", WITHOUT WARRANTY OF ANY KIND, EXPRESS OR
# IMPLIED, INCLUDING BUT NOT LIMITED TO THE WARRANTIES OF MERCHANTABILITY,
# FITNESS FOR A PARTICULAR PURPOSE AND NONINFRINGEMENT. IN NO EVENT SHALL THE
# AUTHORS OR COPYRIGHT HOLDERS BE LIABLE FOR ANY CLAIM, DAMAGES OR OTHER
# LIABILITY, WHETHER IN AN ACTION OF CONTRACT, TORT OR OTHERWISE, ARISING FROM,
# OUT OF OR IN CONNECTION WITH THE SOFTWARE OR THE USE OR OTHER DEALINGS IN THE
# SOFTWARE.

""" Extracts the state of the simulation at a specific time.
    Inputs:
        simulation_results: Simulation results as produced by the simulator.
        time_s:             Time in seconds at which to extract the state. 
    Output:
        simulation_state: Physical objects of the simulation at the given time."""

__author__ = "Tim Schneider"
__version__ = "2020.10.12"

import rhinoscriptsyntax as rs
import Grasshopper as gh

import sys

import bisect

ghcompfolder = gh.Folders.DefaultAssemblyFolder
ghsim_path = ghcompfolder + "ghsim"
if ghsim_path not in sys.path:
    sys.path.append(ghsim_path)
try:
    import ghsim
except:
    ghenv.Component.AddRuntimeMessage(gh.Kernel.GH_RuntimeMessageLevel.Error, 
        "Cannot import ghsim. Please ensure that the ghsim.py "
        "module is installed in \"{}\".".format(ghsim_path))
    ghsim = None

if ghsim:
    ok = True
    if simulation_results is None:
        ghsim.log_error(ghenv, 
            "The \"simulation_results\" parameter must not be empty.")
        ok = False
    if len(simulation_results) == 0 or simulation_results[0] is None:
        ghsim.log_error(ghenv, 
            "\"simulation_results\" must contain at least one time step.")
        ok = False
    if time_s is None:
        ghsim.log_error(ghenv, "The \"time_s\" parameter must not be empty.")
        ok = False
    
    if ok:
        index = bisect.bisect_left(
            [s.time_s for s in simulation_results], time_s)
        index = min(index, len(simulation_results) - 1)
        simulation_state = simulation_results[index].physical_objects
# ---------- end simulationstateat ----------
unpackphysicalobject = UnpackPhysicalObject(physical_object=simulationstateat)  # -> simplify(convex_geometries), transformation
# ---------- unpackphysicalobject: Python ----------
# MIT License
#
# Copyright (c) 2020 Tim Schneider
#
# Permission is hereby granted, free of charge, to any person obtaining a copy
# of this software and associated documentation files (the "Software"), to deal
# in the Software without restriction, including without limitation the rights
# to use, copy, modify, merge, publish, distribute, sublicense, and/or sell
# copies of the Software, and to permit persons to whom the Software is
# furnished to do so, subject to the following conditions:
#
# The above copyright notice and this permission notice shall be included in all
# copies or substantial portions of the Software.
#
# THE SOFTWARE IS PROVIDED "AS IS", WITHOUT WARRANTY OF ANY KIND, EXPRESS OR
# IMPLIED, INCLUDING BUT NOT LIMITED TO THE WARRANTIES OF MERCHANTABILITY,
# FITNESS FOR A PARTICULAR PURPOSE AND NONINFRINGEMENT. IN NO EVENT SHALL THE
# AUTHORS OR COPYRIGHT HOLDERS BE LIABLE FOR ANY CLAIM, DAMAGES OR OTHER
# LIABILITY, WHETHER IN AN ACTION OF CONTRACT, TORT OR OTHERWISE, ARISING FROM,
# OUT OF OR IN CONNECTION WITH THE SOFTWARE OR THE USE OR OTHER DEALINGS IN THE
# SOFTWARE.

"""Unpacks a physical object into its geometries and transformation.
    Inputs:
        physical_object: Physical object to unpack.
    Output:
        convex_geometries:  Convex geometries of the physical object.
        transformation:     Transformation of the physical object."""

__author__ = "Tim Schneider"
__version__ = "2020.10.12"

import rhinoscriptsyntax as rs
import Grasshopper as gh

import sys

ghcompfolder = gh.Folders.DefaultAssemblyFolder
ghsim_path = ghcompfolder + "ghsim"
if ghsim_path not in sys.path:
    sys.path.append(ghsim_path)
try:
    import ghsim
except:
    ghenv.Component.AddRuntimeMessage(gh.Kernel.GH_RuntimeMessageLevel.Error, 
        "Cannot import ghsim. Please ensure that the ghsim.py "
        "module is installed in \"{}\".".format(ghsim_path))
    ghsim = None

if ghsim:
    if physical_object is None:
        ghsim.log_error(ghenv, 
            "The \"physical_object\" parameter must not be empty.")
    else:
        convex_geometries = physical_object.physical_object_type.convex_geometries
        transformation = physical_object.transformation
# ---------- end unpackphysicalobject ----------
mjoin = MeshJoin(Meshes=unpackphysicalobject.convex_geometries)
transform_4 = Transform(Geometry=flatten(mjoin), Transform=unpackphysicalobject.transformation)
preview = CustomPreview(Geometry=transform_4, Material=graft(ColourSwatch(SwatchColor=RGB(5, 81, 158))))
