# Grasshopper definition wasp.gh (Grasshopper 1.0.7)

# ----
# Module Dimensions
amount_of_tips = Slider(4, range=0..10)
length_long = Slider(500, range=0..1000)
tip_height = Slider(45, range=0..100)
length_short = Slider(200, range=0..1000)
width = Slider(300, range=0..1000)
center_box_height = Slider(10, range=0..10)

# ----
# Gaps for Simulation
gap_tip_tip = Slider(4, range=0..10)
gap_tip_sink = Slider(2, range=0..100)
gap_module_module_x_direction = Slider(6, range=0..100)
gap_module_module_y_direction = Slider(0, range=0..100)

# ----
# Wasp Settings
connecting_points_per_row = Slider(2, range=0..10)

# ---- group: Center Box Pybullet
center_box_height_2 = Number(center_box_height)
width_2 = Number(width)
gap_tip_sink_2 = Number(gap_tip_sink)
length = Number(length_short)
subtraction = Subtraction(A=center_box_height_2, B=gap_tip_sink_2)
box = CenterBox(Base=PlaneXY(0, 0, 0), X=expr("x/2", width_2), Y=expr("x/2", length), Z=expr("x/2", subtraction))

center_box_height_3 = Number(center_box_height)
gap_tip_sink_3 = Number(gap_tip_sink)
width_3 = Number(width)
length_2 = Number(length_long)
subtraction_2 = Subtraction(A=center_box_height_3, B=gap_tip_sink_3)
box_2 = CenterBox(Base=PlaneXY(0, 0, 0), X=expr("x/2", width_3), Y=expr("x/2", length_2), Z=expr("x/2", subtraction_2))

# ---- group: Center Box
width_4 = Number(width)
center_box_height_4 = Number(center_box_height)
length_3 = Number(length_short)
box_3 = CenterBox(Base=PlaneXY(0, 0, 0), X=expr("x/2", width_4), Y=expr("x/2", length_3), Z=expr("x/2", center_box_height_4))
debrep = DeconstructBrep(Brep=box_3)  # -> Faces, Edges, Vertices

# ---- group: Tips Above Wasp
tip_height_2 = Number(tip_height)
faces_center_box = Surface(debrep.Faces)
amount_of_tips_2 = Number(amount_of_tips)
length_4 = Number(length_short)
item = ListItem(List=faces_center_box, Index=Slider(5, range=0..10), Wrap=True)
divide = DivideDomain²(Domain=item, UCount=amount_of_tips_2, VCount=1)
division = Division(A=tip_height_2, B=2)
subsrf = Isotrim(Surface=item, Domain=divide)
dim = Dimensions(Surface=subsrf)  # -> UDimension, VDimension
area = Area(Geometry=subsrf)  # -> Area, Centroid
Z = UnitZ(Factor=division)
division_2 = Division(A=dim.UDimension, B=2)
move = Move(Geometry=area.Centroid, Motion=Z)  # -> Geometry, Transform
item_2 = ListItem(List=division_2, Index=0, Wrap=True)
box_4 = CenterBox(Base=move.Geometry, X=expr("x/2", item_2), Y=expr("x/2", length_4), Z=division)

# ----
faces_center_box_2 = Surface(debrep.Faces)

# ---- group: Tips Under Wasp
tip_height_3 = Number(tip_height)
length_5 = Number(length_short)
amount_of_tips_3 = Number(amount_of_tips)
division_3 = Division(A=tip_height_3, B=2)
item_3 = ListItem(List=faces_center_box_2, Index=Slider(4, range=0..10), Wrap=True)
divide_2 = DivideDomain²(Domain=item_3, UCount=1, VCount=amount_of_tips_3)
subsrf_2 = Isotrim(Surface=item_3, Domain=divide_2)
area_2 = Area(Geometry=subsrf_2)  # -> Area, Centroid
dim_2 = Dimensions(Surface=subsrf_2)  # -> UDimension, VDimension
division_4 = Division(A=dim_2.VDimension, B=2)
item_4 = ListItem(List=division_4, Index=0, Wrap=True)
neg = Negative(Value=division_3)
neg_2 = Negative(Value=item_4)
vec = VectorXYZ(XComponent=neg_2, YComponent=0, ZComponent=neg)  # -> Vector, Length
move_2 = Move(Geometry=area_2.Centroid, Motion=vec.Vector)  # -> Geometry, Transform
shift = ShiftList(List=move_2.Geometry, Shift=1, Wrap=Toggle(False))
box_5 = CenterBox(Base=shift, X=expr("x/2", item_4), Y=expr("x/2", length_5), Z=division_3)
tip_width = Number(item_4)

# ---- group: Tips Above Pybullet
faces_center_box_wasp = Surface(debrep.Faces)
amount_of_tips_4 = Number(amount_of_tips)
length_6 = Number(length_short)
tip_height_4 = Number(tip_height)
gap_tip_tip_2 = Number(gap_tip_tip)
division_5 = Division(A=tip_height_4, B=2)
item_5 = ListItem(List=faces_center_box_wasp, Index=Slider(5, range=0..10), Wrap=True)
divide_3 = DivideDomain²(Domain=item_5, UCount=amount_of_tips_4, VCount=1)
Z_2 = UnitZ(Factor=division_5)
subsrf_3 = Isotrim(Surface=item_5, Domain=divide_3)
dim_3 = Dimensions(Surface=subsrf_3)  # -> UDimension, VDimension
area_3 = Area(Geometry=subsrf_3)  # -> Area, Centroid
division_6 = Division(A=dim_3.UDimension, B=2)
move_3 = Move(Geometry=area_3.Centroid, Motion=Z_2)  # -> Geometry, Transform
item_6 = ListItem(List=division_6, Index=0, Wrap=True)
subtraction_3 = Subtraction(A=item_6, B=gap_tip_tip_2)
box_6 = CenterBox(Base=move_3.Geometry, X=expr("x/2", subtraction_3), Y=expr("x/2", length_6), Z=division_5)

# ---- group: Tips Under Pybullet
faces_center_box_wasp_2 = Surface(debrep.Faces)
amount_of_tips_5 = Number(amount_of_tips)
length_7 = Number(length_short)
tip_height_5 = Number(tip_height)
gap_tip_tip_3 = Number(gap_tip_tip)
division_7 = Division(A=tip_height_5, B=2)
item_7 = ListItem(List=faces_center_box_wasp_2, Index=Slider(4, range=0..10), Wrap=True)
divide_4 = DivideDomain²(Domain=item_7, UCount=1, VCount=amount_of_tips_5)
subsrf_4 = Isotrim(Surface=item_7, Domain=divide_4)
dim_4 = Dimensions(Surface=subsrf_4)  # -> UDimension, VDimension
area_4 = Area(Geometry=subsrf_4)  # -> Area, Centroid
division_8 = Division(A=dim_4.VDimension, B=2)
item_8 = ListItem(List=division_8, Index=0, Wrap=True)
neg_3 = Negative(Value=item_8)
neg_4 = Negative(Value=division_7)
vec_2 = VectorXYZ(XComponent=neg_3, YComponent=0, ZComponent=neg_4)  # -> Vector, Length
move_4 = Move(Geometry=area_4.Centroid, Motion=vec_2.Vector)  # -> Geometry, Transform
subtraction_4 = Subtraction(A=item_8, B=gap_tip_tip_3)
shift_2 = ShiftList(List=move_4.Geometry, Shift=1, Wrap=Toggle(False))
box_7 = CenterBox(Base=shift_2, X=expr("x/2", subtraction_4), Y=expr("x/2", length_7), Z=division_7)
tip_width_2 = Number(item_8)

# ---- group: Right half tip Pybullet
tip_width_3 = Number(tip_width_2)
vertices_center_box = Point(debrep.Vertices)
tip_height_6 = Number(tip_height)
length_8 = Number(length_short)
gap_tip_tip_4 = Number(gap_tip_tip)
subtraction_5 = Subtraction(A=tip_width_3, B=gap_tip_tip_4)
division_9 = Division(A=subtraction_5, B=2)
neg_5 = Negative(Value=tip_height_6)
item_9 = ListItem(List=vertices_center_box, Index=Slider(1, range=0..1), Wrap=True)
neg_6 = Negative(Value=division_9)
box_8 = DomainBox(Base=item_9, X=neg_6, Y=length_8, Z=neg_5)

# ---- group: Left half tip Pybullet
vertices_center_box_2 = Point(debrep.Vertices)
tip_height_7 = Number(tip_height)
tip_width_4 = Number(tip_width_2)
length_9 = Number(length_short)
gap_tip_tip_5 = Number(gap_tip_tip)
subtraction_6 = Subtraction(A=tip_width_4, B=gap_tip_tip_5)
item_10 = ListItem(List=vertices_center_box_2, Index=0, Wrap=True)
division_10 = Division(A=subtraction_6, B=2)
neg_7 = Negative(Value=tip_height_7)
box_9 = DomainBox(Base=item_10, X=division_10, Y=length_9, Z=neg_7)

# ---- group: Right half tip Wasp
length_10 = Number(length_short)
tip_width_5 = Number(tip_width)
tip_height_8 = Number(tip_height)
vertices_center_box_3 = Point(debrep.Vertices)
division_11 = Division(A=tip_width_5, B=2)
neg_8 = Negative(Value=tip_height_8)
item_11 = ListItem(List=vertices_center_box_3, Index=Slider(1, range=0..1), Wrap=True)
neg_9 = Negative(Value=division_11)
box_10 = DomainBox(Base=item_11, X=neg_9, Y=length_10, Z=neg_8)

# ---- group: Left half tip Wasp
vertices_center_box_4 = Point(debrep.Vertices)
tip_width_6 = Number(tip_width)
length_11 = Number(length_short)
tip_height_9 = Number(tip_height)
item_12 = ListItem(List=vertices_center_box_4, Index=0, Wrap=True)
division_12 = Division(A=tip_width_6, B=2)
neg_10 = Negative(Value=tip_height_9)
box_11 = DomainBox(Base=item_12, X=division_12, Y=length_11, Z=neg_10)

# ---- group: Center Box
center_box_height_5 = Number(center_box_height)
width_5 = Number(width)
length_12 = Number(length_long)
box_12 = CenterBox(Base=PlaneXY(0, 0, 0), X=expr("x/2", width_5), Y=expr("x/2", length_12), Z=expr("x/2", center_box_height_5))
debrep_2 = DeconstructBrep(Brep=box_12)  # -> Faces, Edges, Vertices

# ---- group: Tips Above Wasp
tip_height_10 = Number(tip_height)
faces_center_box_3 = Surface(debrep_2.Faces)
amount_of_tips_6 = Number(amount_of_tips)
length_13 = Number(length_long)
item_13 = ListItem(List=faces_center_box_3, Index=Slider(5, range=0..10), Wrap=True)
divide_5 = DivideDomain²(Domain=item_13, UCount=amount_of_tips_6, VCount=1)
division_13 = Division(A=tip_height_10, B=2)
subsrf_5 = Isotrim(Surface=item_13, Domain=divide_5)
dim_5 = Dimensions(Surface=subsrf_5)  # -> UDimension, VDimension
area_5 = Area(Geometry=subsrf_5)  # -> Area, Centroid
Z_3 = UnitZ(Factor=division_13)
division_14 = Division(A=dim_5.UDimension, B=2)
move_5 = Move(Geometry=area_5.Centroid, Motion=Z_3)  # -> Geometry, Transform
item_14 = ListItem(List=division_14, Index=0, Wrap=True)
box_13 = CenterBox(Base=move_5.Geometry, X=expr("x/2", item_14), Y=expr("x/2", length_13), Z=division_13)

# ----
faces_center_box_4 = Surface(debrep_2.Faces)

# ---- group: Tips Under Wasp
tip_height_11 = Number(tip_height)
length_14 = Number(length_long)
amount_of_tips_7 = Number(amount_of_tips)
division_15 = Division(A=tip_height_11, B=2)
item_15 = ListItem(List=faces_center_box_4, Index=Slider(4, range=0..10), Wrap=True)
divide_6 = DivideDomain²(Domain=item_15, UCount=1, VCount=amount_of_tips_7)
subsrf_6 = Isotrim(Surface=item_15, Domain=divide_6)
area_6 = Area(Geometry=subsrf_6)  # -> Area, Centroid
dim_6 = Dimensions(Surface=subsrf_6)  # -> UDimension, VDimension
division_16 = Division(A=dim_6.VDimension, B=2)
item_16 = ListItem(List=division_16, Index=0, Wrap=True)
neg_11 = Negative(Value=division_15)
neg_12 = Negative(Value=item_16)
vec_3 = VectorXYZ(XComponent=neg_12, YComponent=0, ZComponent=neg_11)  # -> Vector, Length
move_6 = Move(Geometry=area_6.Centroid, Motion=vec_3.Vector)  # -> Geometry, Transform
shift_3 = ShiftList(List=move_6.Geometry, Shift=1, Wrap=Toggle(False))
box_14 = CenterBox(Base=shift_3, X=expr("x/2", item_16), Y=expr("x/2", length_14), Z=division_15)
tip_width_7 = Number(item_16)

# ---- group: Tips Above Pybullet
faces_center_box_wasp_3 = Surface(debrep_2.Faces)
amount_of_tips_8 = Number(amount_of_tips)
length_15 = Number(length_long)
tip_height_12 = Number(tip_height)
gap_tip_tip_6 = Number(gap_tip_tip)
division_17 = Division(A=tip_height_12, B=2)
item_17 = ListItem(List=faces_center_box_wasp_3, Index=Slider(5, range=0..10), Wrap=True)
divide_7 = DivideDomain²(Domain=item_17, UCount=amount_of_tips_8, VCount=1)
Z_4 = UnitZ(Factor=division_17)
subsrf_7 = Isotrim(Surface=item_17, Domain=divide_7)
dim_7 = Dimensions(Surface=subsrf_7)  # -> UDimension, VDimension
area_7 = Area(Geometry=subsrf_7)  # -> Area, Centroid
division_18 = Division(A=dim_7.UDimension, B=2)
move_7 = Move(Geometry=area_7.Centroid, Motion=Z_4)  # -> Geometry, Transform
item_18 = ListItem(List=division_18, Index=0, Wrap=True)
subtraction_7 = Subtraction(A=item_18, B=gap_tip_tip_6)
box_15 = CenterBox(Base=move_7.Geometry, X=expr("x/2", subtraction_7), Y=expr("x/2", length_15), Z=division_17)

# ---- group: Tips Under Pybullet
faces_center_box_wasp_4 = Surface(debrep_2.Faces)
amount_of_tips_9 = Number(amount_of_tips)
length_16 = Number(length_long)
tip_height_13 = Number(tip_height)
gap_tip_tip_7 = Number(gap_tip_tip)
division_19 = Division(A=tip_height_13, B=2)
item_19 = ListItem(List=faces_center_box_wasp_4, Index=Slider(4, range=0..10), Wrap=True)
divide_8 = DivideDomain²(Domain=item_19, UCount=1, VCount=amount_of_tips_9)
subsrf_8 = Isotrim(Surface=item_19, Domain=divide_8)
dim_8 = Dimensions(Surface=subsrf_8)  # -> UDimension, VDimension
area_8 = Area(Geometry=subsrf_8)  # -> Area, Centroid
division_20 = Division(A=dim_8.VDimension, B=2)
item_20 = ListItem(List=division_20, Index=0, Wrap=True)
neg_13 = Negative(Value=item_20)
neg_14 = Negative(Value=division_19)
vec_4 = VectorXYZ(XComponent=neg_13, YComponent=0, ZComponent=neg_14)  # -> Vector, Length
move_8 = Move(Geometry=area_8.Centroid, Motion=vec_4.Vector)  # -> Geometry, Transform
subtraction_8 = Subtraction(A=item_20, B=gap_tip_tip_7)
shift_4 = ShiftList(List=move_8.Geometry, Shift=1, Wrap=Toggle(False))
box_16 = CenterBox(Base=shift_4, X=expr("x/2", subtraction_8), Y=expr("x/2", length_16), Z=division_19)
tip_width_8 = Number(item_20)

# ---- group: Right half tip Pybullet
tip_width_9 = Number(tip_width_8)
vertices_center_box_5 = Point(debrep_2.Vertices)
tip_height_14 = Number(tip_height)
length_17 = Number(length_long)
gap_tip_tip_8 = Number(gap_tip_tip)
subtraction_9 = Subtraction(A=tip_width_9, B=gap_tip_tip_8)
division_21 = Division(A=subtraction_9, B=2)
neg_15 = Negative(Value=tip_height_14)
item_21 = ListItem(List=vertices_center_box_5, Index=Slider(1, range=0..1), Wrap=True)
neg_16 = Negative(Value=division_21)
box_17 = DomainBox(Base=item_21, X=neg_16, Y=length_17, Z=neg_15)

# ---- group: Left half tip Pybullet
vertices_center_box_6 = Point(debrep_2.Vertices)
tip_height_15 = Number(tip_height)
tip_width_10 = Number(tip_width_8)
length_18 = Number(length_long)
gap_tip_tip_9 = Number(gap_tip_tip)
subtraction_10 = Subtraction(A=tip_width_10, B=gap_tip_tip_9)
item_22 = ListItem(List=vertices_center_box_6, Index=0, Wrap=True)
division_22 = Division(A=subtraction_10, B=2)
neg_17 = Negative(Value=tip_height_15)
box_18 = DomainBox(Base=item_22, X=division_22, Y=length_18, Z=neg_17)

# ---- group: Right half tip Wasp
length_19 = Number(length_long)
tip_width_11 = Number(tip_width_7)
tip_height_16 = Number(tip_height)
vertices_center_box_7 = Point(debrep_2.Vertices)
division_23 = Division(A=tip_width_11, B=2)
neg_18 = Negative(Value=tip_height_16)
item_23 = ListItem(List=vertices_center_box_7, Index=Slider(1, range=0..1), Wrap=True)
neg_19 = Negative(Value=division_23)
box_19 = DomainBox(Base=item_23, X=neg_19, Y=length_19, Z=neg_18)

# ---- group: Left half tip Wasp
vertices_center_box_8 = Point(debrep_2.Vertices)
tip_width_12 = Number(tip_width_7)
length_20 = Number(length_long)
tip_height_17 = Number(tip_height)
item_24 = ListItem(List=vertices_center_box_8, Index=0, Wrap=True)
division_24 = Division(A=tip_width_12, B=2)
neg_20 = Negative(Value=tip_height_17)
box_20 = DomainBox(Base=item_24, X=division_24, Y=length_20, Z=neg_20)

# ---- group: Wasp Part
half_tip_right = Box(box_10)
center_box = Box(box_3)
tips_above = Box(box_4)
tips_under = Box(box_5)
half_tip_left = Box(box_11)
merge = Merge(Data1=tips_above, Data2=center_box, Data3=tips_under, Data4=half_tip_right, Data5=half_tip_left)
sunion = SolidUnion(Breps=flatten(merge))

half_tip_right_2 = Box(box_19)
center_box_2 = Box(box_12)
tips_under_2 = Box(box_14)
tips_above_2 = Box(box_13)
half_tip_left_2 = Box(box_20)
merge_2 = Merge(Data1=tips_above_2, Data2=center_box_2, Data3=tips_under_2, Data4=half_tip_right_2, Data5=half_tip_left_2)
sunion_2 = SolidUnion(Breps=flatten(merge_2))

# ---- group: Pybullet Part Temp
tips_above_pybullet = Box(box_6)
center_box_pybullet = Box(box)
half_tip_right_3 = Box(box_8)
tips_under_pybullet = Box(box_7)
half_tip_left_3 = Box(box_9)
merge_3 = Merge(
    Data1=center_box_pybullet,
    Data2=tips_above_pybullet,
    Data3=tips_under_pybullet,
    Data4=half_tip_right_3,
    Data5=half_tip_left_3)  # -> flatten(Result)
module_pybullet_temp = Box(merge_3)

center_box_pybullet_2 = Box(box_2)
tips_above_pybullet_2 = Box(box_15)
half_tip_right_4 = Box(box_17)
tips_under_pybullet_2 = Box(box_16)
half_tip_left_4 = Box(box_18)
merge_4 = Merge(
    Data1=center_box_pybullet_2,
    Data2=tips_above_pybullet_2,
    Data3=tips_under_pybullet_2,
    Data4=half_tip_right_4,
    Data5=half_tip_left_4)  # -> flatten(Result)
module_pybullet_temp_2 = Box(merge_4)

# ----
# WASP SHORT PART
# GEOMETRY
module_wasp = Brep(sunion)
dam = DataDam(DataA=module_wasp, BufferDelay=10000000, BufferMode=0)

# ----
# WASP LONG PART
# GEOMETRY
module_wasp_2 = Brep(sunion_2)
dam_2 = DataDam(DataA=module_wasp_2, BufferDelay=10000000, BufferMode=0)

# ----
# PYBULLET PART SHORT
gap_module_module_y_direction_2 = Number(gap_module_module_y_direction)
module_wasp_3 = Brep(module_wasp)
gap_module_module_x_direction_2 = Number(gap_module_module_x_direction)
module_pybullet_temp_3 = Box(module_pybullet_temp)
gap_tip_sink_4 = Number(gap_tip_sink)
bbox = BoundingBox(Content=module_wasp_3, Plane=PlaneXY(0, 0, 0))  # -> Box, Box_2
area_9 = Area(Geometry=bbox.Box)  # -> Area, Centroid
debox = DeconstructBox(Box=bbox.Box_2)  # -> Plane, X, Y, Z
num = Number(debox.X)
num_2 = Number(debox.Y)
num_3 = Number(debox.Z)
subtraction_11 = Subtraction(A=num, B=gap_module_module_x_direction_2)
subtraction_12 = Subtraction(A=num_2, B=gap_module_module_y_direction_2)
subtraction_13 = Subtraction(A=num_3, B=gap_tip_sink_4)
box_21 = CenterBox(Base=area_9.Centroid, X=expr("x/2", subtraction_11), Y=expr("x/2", subtraction_12), Z=expr("x/2", subtraction_13))
sint = SolidIntersection(BrepsA=module_pybullet_temp_3, BrepsB=box_21)  # -> simplify(flatten(Result))

# ----
# PYBULLET PART SHORT
module_wasp_4 = Brep(module_wasp_2)
gap_module_module_y_direction_3 = Number(gap_module_module_y_direction)
module_pybullet_temp_4 = Box(module_pybullet_temp_2)
gap_module_module_x_direction_3 = Number(gap_module_module_x_direction)
gap_tip_sink_5 = Number(gap_tip_sink)
bbox_2 = BoundingBox(Content=module_wasp_4, Plane=PlaneXY(0, 0, 0))  # -> Box, Box_2
area_10 = Area(Geometry=bbox_2.Box)  # -> Area, Centroid
debox_2 = DeconstructBox(Box=bbox_2.Box_2)  # -> Plane, X, Y, Z
num_4 = Number(debox_2.X)
num_5 = Number(debox_2.Y)
num_6 = Number(debox_2.Z)
subtraction_14 = Subtraction(A=num_4, B=gap_module_module_x_direction_3)
subtraction_15 = Subtraction(A=num_5, B=gap_module_module_y_direction_3)
subtraction_16 = Subtraction(A=num_6, B=gap_tip_sink_5)
box_22 = CenterBox(Base=area_10.Centroid, X=expr("x/2", subtraction_14), Y=expr("x/2", subtraction_15), Z=expr("x/2", subtraction_16))
sint_2 = SolidIntersection(BrepsA=module_pybullet_temp_4, BrepsB=box_22)  # -> simplify(flatten(Result))

# ----
# PYBULLET SHORT PART
# DECOMPOSED GEOMETRY
module_pybullet = Box(sint)

# ----
# PYBULLET SHORT PART
# DECOMPOSED GEOMETRY
module_pybullet_2 = Box(sint_2)

module_wasp_5 = Brep(dam_2)
debrep_3 = DeconstructBrep(Brep=flatten(module_wasp_5))  # -> Faces, Edges, Vertices
module_faces = Surface(debrep_3.Faces)

module_wasp_6 = Brep(dam)
debrep_4 = DeconstructBrep(Brep=flatten(module_wasp_6))  # -> Faces, Edges, Vertices
module_faces_2 = Surface(debrep_4.Faces)

# ---- group: Connections Sink
connecting_points_per_row_2 = Number(connecting_points_per_row)
module_wasp_7 = Brep(module_wasp_5)
module_faces_3 = Surface(module_faces)
panel = Panel("""34
29
39
44""")
panel_2 = Panel("""4
9
14""")
item_25 = ListItem(List=flatten(module_faces_3), Index=panel, Wrap=True)
item_26 = ListItem(List=flatten(module_faces_3), Index=panel_2, Wrap=True)
divide_9 = DivideDomain²(Domain=item_25, UCount=1, VCount=connecting_points_per_row_2)
divide_10 = DivideDomain²(Domain=item_26, UCount=connecting_points_per_row_2, VCount=1)
subsrf_9 = Isotrim(Surface=graft(item_25), Domain=divide_9)
subsrf_10 = Isotrim(Surface=graft(item_26), Domain=divide_10)
area_11 = Area(Geometry=flatten([subsrf_9, subsrf_10]))  # -> Area, Centroid
Y = UnitY(Factor=1)
line = LineSDL(Start=area_11.Centroid, Direction=Y, Length=1)
conndir = Wasp_ConnectionFromDirection(GEO=module_wasp_7, CEN=area_11.Centroid, UP=line, T="TIP")  # -> CONN, PLN_OUT; inputs CEN: list of Point3d, UP: list of Curve, T: list; plug-in component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

# ---- group: Connections Tip
connecting_points_per_row_3 = Number(connecting_points_per_row)
module_faces_4 = Surface(module_faces)
module_wasp_8 = Brep(module_wasp_5)
tip_width_13 = Number(tip_width_2)
item_27 = ListItem(List=flatten(module_faces_4), Index="53", Wrap=True)
item_28 = ListItem(List=flatten(module_faces_4), Index="56", Wrap=True)
divide_11 = DivideDomain²(Domain=item_27, UCount=4, VCount=connecting_points_per_row_3)
divide_12 = DivideDomain²(Domain=item_28, UCount=connecting_points_per_row_3, VCount=4)
shift_5 = ShiftList(List=divide_11, Shift=connecting_points_per_row_3, Wrap=False)
subsrf_11 = Isotrim(Surface=graft(item_27), Domain=shift_5)
subsrf_12 = Isotrim(Surface=graft(item_28), Domain=divide_12)
neg_21 = Negative(Value=tip_width_13)
area_12 = Area(Geometry=subsrf_11)  # -> Area, Centroid
area_13 = Area(Geometry=subsrf_12)  # -> Area, Centroid
X = UnitX(Factor=neg_21)
move_9 = Move(Geometry=area_12.Centroid, Motion=X)  # -> Geometry, Transform
Y_2 = UnitY(Factor=1)
line_2 = LineSDL(Start=[move_9.Geometry, area_13.Centroid], Direction=Y_2, Length=1)
conndir_2 = Wasp_ConnectionFromDirection(GEO=module_wasp_8, CEN=[move_9.Geometry, area_13.Centroid], UP=line_2, T="SINK")  # -> CONN, PLN_OUT; inputs CEN: list of Point3d, UP: list of Curve, T: list; plug-in component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

# ---- group: Connections Side
module_wasp_9 = Brep(module_wasp_5)
module_faces_5 = Surface(module_faces)
panel_3 = Panel("""21
18""")
item_29 = ListItem(List=flatten(module_faces_5), Index=panel_3, Wrap=True)
area_14 = Area(Geometry=item_29)  # -> Area, Centroid
Z_5 = UnitZ(Factor=1)
line_3 = LineSDL(Start=area_14.Centroid, Direction=Z_5, Length=1)
conndir_3 = Wasp_ConnectionFromDirection(GEO=module_wasp_9, CEN=area_14.Centroid, UP=line_3, T="SIDE")  # -> CONN, PLN_OUT; inputs CEN: list of Point3d, UP: list of Curve, T: list; plug-in component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

# ---- group: Connections Front
module_wasp_10 = Brep(module_wasp_5)
bbox_3 = BoundingBox(Content=module_wasp_10, Plane=PlaneXY(0, 0, 0))  # -> Box, Box_2
debrep_5 = DeconstructBrep(Brep=bbox_3.Box)  # -> Faces, Edges, Vertices
area_15 = Area(Geometry=debrep_5.Faces)  # -> Area, Centroid
panel_4 = Panel("""0
2""")
item_30 = ListItem(List=area_15.Centroid, Index=panel_4, Wrap=True)
Z_6 = UnitZ(Factor=1)
line_4 = LineSDL(Start=item_30, Direction=Z_6, Length=1)
conndir_4 = Wasp_ConnectionFromDirection(GEO=module_wasp_10, CEN=item_30, UP=line_4, T="FRONT")  # -> CONN, PLN_OUT; inputs CEN: list of Point3d, UP: list of Curve, T: list; plug-in component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

# ---- group: Connections Sink
connecting_points_per_row_4 = Number(connecting_points_per_row)
module_wasp_11 = Brep(module_wasp_6)
module_faces_6 = Surface(module_faces_2)
panel_5 = Panel("""34
29
39
44""")
panel_6 = Panel("""4
9
14""")
item_31 = ListItem(List=flatten(module_faces_6), Index=panel_5, Wrap=True)
item_32 = ListItem(List=flatten(module_faces_6), Index=panel_6, Wrap=True)
divide_13 = DivideDomain²(Domain=item_31, UCount=1, VCount=connecting_points_per_row_4)
divide_14 = DivideDomain²(Domain=item_32, UCount=connecting_points_per_row_4, VCount=1)
subsrf_13 = Isotrim(Surface=graft(item_31), Domain=divide_13)
subsrf_14 = Isotrim(Surface=graft(item_32), Domain=divide_14)
area_16 = Area(Geometry=flatten([subsrf_13, subsrf_14]))  # -> Area, Centroid
Y_3 = UnitY(Factor=1)
line_5 = LineSDL(Start=area_16.Centroid, Direction=Y_3, Length=1)
conndir_5 = Wasp_ConnectionFromDirection(GEO=module_wasp_11, CEN=area_16.Centroid, UP=line_5, T="TIP")  # -> CONN, PLN_OUT; inputs CEN: list of Point3d, UP: list of Curve, T: list; plug-in component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

# ---- group: Connections Tip
connecting_points_per_row_5 = Number(connecting_points_per_row)
module_faces_7 = Surface(module_faces_2)
module_wasp_12 = Brep(module_wasp_6)
tip_width_14 = Number(tip_width_2)
item_33 = ListItem(List=flatten(module_faces_7), Index="53", Wrap=True)
item_34 = ListItem(List=flatten(module_faces_7), Index="56", Wrap=True)
divide_15 = DivideDomain²(Domain=item_33, UCount=4, VCount=connecting_points_per_row_5)
divide_16 = DivideDomain²(Domain=item_34, UCount=connecting_points_per_row_5, VCount=4)
shift_6 = ShiftList(List=divide_15, Shift=connecting_points_per_row_5, Wrap=False)
subsrf_15 = Isotrim(Surface=graft(item_33), Domain=shift_6)
subsrf_16 = Isotrim(Surface=graft(item_34), Domain=divide_16)
neg_22 = Negative(Value=tip_width_14)
area_17 = Area(Geometry=subsrf_15)  # -> Area, Centroid
area_18 = Area(Geometry=subsrf_16)  # -> Area, Centroid
X_2 = UnitX(Factor=neg_22)
move_10 = Move(Geometry=area_17.Centroid, Motion=X_2)  # -> Geometry, Transform
Y_4 = UnitY(Factor=1)
line_6 = LineSDL(Start=[move_10.Geometry, area_18.Centroid], Direction=Y_4, Length=1)
conndir_6 = Wasp_ConnectionFromDirection(GEO=module_wasp_12, CEN=[move_10.Geometry, area_18.Centroid], UP=line_6, T="SINK")  # -> CONN, PLN_OUT; inputs CEN: list of Point3d, UP: list of Curve, T: list; plug-in component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

# ---- group: Connections Side
module_wasp_13 = Brep(module_wasp_6)
module_faces_8 = Surface(module_faces_2)
panel_7 = Panel("""21
18""")
item_35 = ListItem(List=flatten(module_faces_8), Index=panel_7, Wrap=True)
area_19 = Area(Geometry=item_35)  # -> Area, Centroid
Z_7 = UnitZ(Factor=1)
line_7 = LineSDL(Start=area_19.Centroid, Direction=Z_7, Length=1)
conndir_7 = Wasp_ConnectionFromDirection(GEO=module_wasp_13, CEN=area_19.Centroid, UP=line_7, T="SIDE")  # -> CONN, PLN_OUT; inputs CEN: list of Point3d, UP: list of Curve, T: list; plug-in component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

# ---- group: Connections Front
module_wasp_14 = Brep(module_wasp_6)
bbox_4 = BoundingBox(Content=module_wasp_14, Plane=PlaneXY(0, 0, 0))  # -> Box, Box_2
debrep_6 = DeconstructBrep(Brep=bbox_4.Box)  # -> Faces, Edges, Vertices
area_20 = Area(Geometry=debrep_6.Faces)  # -> Area, Centroid
panel_8 = Panel("""0
2""")
item_36 = ListItem(List=area_20.Centroid, Index=panel_8, Wrap=True)
Z_8 = UnitZ(Factor=1)
line_8 = LineSDL(Start=item_36, Direction=Z_8, Length=1)
conndir_8 = Wasp_ConnectionFromDirection(GEO=module_wasp_14, CEN=item_36, UP=line_8, T="FRONT")  # -> CONN, PLN_OUT; inputs CEN: list of Point3d, UP: list of Curve, T: list; plug-in component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

# ---- group: LONG MODULE WASP
module_wasp_15 = Brep(module_wasp_5)
panel_9 = Panel("long")
merge_5 = Merge(Data1=conndir_2.CONN, Data2=conndir.CONN, Data3=conndir_4.CONN, Data4=conndir_3.CONN)
part = Wasp_BasicPart(NAME=panel_9, GEO=module_wasp_15, CONN=flatten(merge_5))  # -> PART; inputs GEO: Mesh, CONN: list, COLL: Mesh, ATTR: list; plug-in component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

# ---- group: SHORT MODULE WASP
module_wasp_16 = Brep(module_wasp_6)
panel_10 = Panel("short")
merge_6 = Merge(Data1=conndir_6.CONN, Data2=conndir_5.CONN, Data3=conndir_8.CONN, Data4=conndir_7.CONN)
part_2 = Wasp_BasicPart(NAME=panel_10, GEO=module_wasp_16, CONN=flatten(merge_6))  # -> PART; inputs GEO: Mesh, CONN: list, COLL: Mesh, ATTR: list; plug-in component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

# ----
merge_7 = Merge(Data1=part_2, Data2=part)
merge_8 = Merge(Data1=panel_10, Data2=panel_9)

aggregation_rules = Panel("""TIP>SINK
SINK>TIP
FRONT>FRONT
SIDE>SIDE""")
rulegen = Wasp_RulesGenerator(PART=merge_7, GR=aggregation_rules)  # -> R; inputs PART: list, SELF_P: Boolean, SELF_C: Boolean, TYP: Boolean, GR: list; plug-in component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

part_count = Slider(20, range=0..1000)
reset_aggregation = Button()
stochasticaggregation = Wasp_StochasticAggregation(PART=flatten(merge_7), N=part_count, RULES=rulegen, RESET=reset_aggregation)  # -> AGGR, PART_OUT; inputs PART: list, PREV: list, N: Int32, RULES: list, MODE: Int32, GC: list, RESET: Boolean; plug-in component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

namefilter = Wasp_FilterPartsByName(PART=stochasticaggregation.PART_OUT, NAME=merge_8)  # -> PART_OUT, MASK; inputs PART: list, NAME: list; plug-in component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
partgeo = Wasp_GetPartGeometry(PART=namefilter.PART_OUT)  # -> GEO; plug-in component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
merge_9 = Merge(Data1=ColourSwatch(SwatchColor=RGB(158, 5, 5)), Data2=ColourSwatch(SwatchColor=RGB(61, 158, 5)))
preview = CustomPreview(Geometry=partgeo, Material=graft(merge_9))

mass = Slider(0.2, range=0..15)
mass_2 = Slider(0.1, range=0..15)
physicalobjecttype = CreatePhysicalObjectType(name="short", convex_geometries=module_pybullet, mass_kg=mass_2)  # -> physical_object_type; inputs convex_geometries: list of Mesh
# ---------- physicalobjecttype: Python ----------
# MIT License
#
# Copyright (c) 2020 Tim Schneider
#
# Permission is hereby granted, free of charge, to any person obtaining a copy
# of this software and associated documentation files (the "Software"), to deal
# in the Software without restriction, including without limitation the rights
# to use, copy, modify, merge, publish, distribute, sublicense, and/or sell
# copies of the Software, and to permit persons to whom the Software is
# furnished to do so, subject to the following conditions:
#
# The above copyright notice and this permission notice shall be included in all
# copies or substantial portions of the Software.
#
# THE SOFTWARE IS PROVIDED "AS IS", WITHOUT WARRANTY OF ANY KIND, EXPRESS OR
# IMPLIED, INCLUDING BUT NOT LIMITED TO THE WARRANTIES OF MERCHANTABILITY,
# FITNESS FOR A PARTICULAR PURPOSE AND NONINFRINGEMENT. IN NO EVENT SHALL THE
# AUTHORS OR COPYRIGHT HOLDERS BE LIABLE FOR ANY CLAIM, DAMAGES OR OTHER
# LIABILITY, WHETHER IN AN ACTION OF CONTRACT, TORT OR OTHERWISE, ARISING FROM,
# OUT OF OR IN CONNECTION WITH THE SOFTWARE OR THE USE OR OTHER DEALINGS IN THE
# SOFTWARE.

"""Creates a type of physical object for simulation.
    Inputs:
        name:               Name of this physical object type.
        convex_geometries:  Convex geometric shapes this physical object type 
                            consists of. Note that using non-convex geometric
                            shapes is generally possible but might result in an
                            unstable stable simulation. Instead, decompose any
                            geometric shapeinto multiple convex shapes before 
                            using it in the simulation.
        mass_kg:            Mass of this physical object type in kg (default 1kg).
        lateral_friction:   Friction of this object sliding over another object.
        spinning_friction:  Friction of this object spinning on another object
                            (e.g. a top spinning on a table).
        rolling_friction:   Friction of an object rolling over another object 
                            (e.g. a wheel rolling over the ground).
                            For details on how to set these values, please refer
                            to the documentation of the bullet physics engine.
    Output:
        physical_object_type: A physical object type."""
        
__author__ = "Tim Schneider"
__version__ = "2020.10.12"
        
import rhinoscriptsyntax as rs
import Grasshopper as gh
        
import sys
        
ghcompfolder = gh.Folders.DefaultAssemblyFolder
ghsim_path = ghcompfolder + "ghsim"
if ghsim_path not in sys.path:
    sys.path.append(ghsim_path)
try:
    import ghsim
except:
    ghenv.Component.AddRuntimeMessage(gh.Kernel.GH_RuntimeMessageLevel.Error, 
        "Cannot import ghsim. Please ensure that the ghsim.py "
        "module is installed in \"{}\".".format(ghsim_path))
    ghsim = None

if ghsim:
    ok = True
    if name is None:
        ok = False
        ghsim.log_error(ghenv, "The \"name\" parameter must not be empty.")
    if convex_geometries is None:
        ok = False
        ghsim.log_error(ghenv, 
            "The \"convex_geometries\" parameter must not be empty.")
    if mass_kg is None:
        mass_kg = 1.0
    dynamics = {}
    if lateral_friction is not None:
        dynamics["lateralFriction"] = lateral_friction
    if spinning_friction is not None:
        dynamics["spinningFriction"] = spinning_friction
    if rolling_friction is not None:
        dynamics["rollingFriction"] = rolling_friction

if ok:
    physical_object_type = ghsim.PhysicalObjectType(name, convex_geometries,
        mass_kg, dynamics)
# ---------- end physicalobjecttype ----------
physicalobjecttype_2 = CreatePhysicalObjectType(name="long", convex_geometries=module_pybullet_2, mass_kg=mass)  # -> physical_object_type; inputs convex_geometries: list of Mesh; same code as physicalobjecttype
namefilter_2 = Wasp_FilterPartsByName(PART=stochasticaggregation.PART_OUT, NAME="short")  # -> PART_OUT, MASK; inputs PART: list, NAME: list; plug-in component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
namefilter_3 = Wasp_FilterPartsByName(PART=stochasticaggregation.PART_OUT, NAME="long")  # -> PART_OUT, MASK; inputs PART: list, NAME: list; plug-in component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
depart = Wasp_DeconstructPart(PART=namefilter_2.PART_OUT)  # -> NAME, ID, GEO, CONN, COLL, TR, PARENT, CHILD, ADD_COLL, ATTR; plug-in component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
depart_2 = Wasp_DeconstructPart(PART=namefilter_3.PART_OUT)  # -> NAME, ID, GEO, CONN, COLL, TR, PARENT, CHILD, ADD_COLL, ATTR; plug-in component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
physicalobject = CreatePhysicalObject(physical_object_type=physicalobjecttype, transformation=depart.TR)  # -> physical_object; inputs transformation: Transform
# ---------- physicalobject: Python ----------
# MIT License
#
# Copyright (c) 2020 Tim Schneider
#
# Permission is hereby granted, free of charge, to any person obtaining a copy
# of this software and associated documentation files (the "Software"), to deal
# in the Software without restriction, including without limitation the rights
# to use, copy, modify, merge, publish, distribute, sublicense, and/or sell
# copies of the Software, and to permit persons to whom the Software is
# furnished to do so, subject to the following conditions:
#
# The above copyright notice and this permission notice shall be included in all
# copies or substantial portions of the Software.
#
# THE SOFTWARE IS PROVIDED "AS IS", WITHOUT WARRANTY OF ANY KIND, EXPRESS OR
# IMPLIED, INCLUDING BUT NOT LIMITED TO THE WARRANTIES OF MERCHANTABILITY,
# FITNESS FOR A PARTICULAR PURPOSE AND NONINFRINGEMENT. IN NO EVENT SHALL THE
# AUTHORS OR COPYRIGHT HOLDERS BE LIABLE FOR ANY CLAIM, DAMAGES OR OTHER
# LIABILITY, WHETHER IN AN ACTION OF CONTRACT, TORT OR OTHERWISE, ARISING FROM,
# OUT OF OR IN CONNECTION WITH THE SOFTWARE OR THE USE OR OTHER DEALINGS IN THE
# SOFTWARE.

"""Creates a physical object for the simulation.
    Inputs:
        physical_object_type:   Type of the physical object to create.
        transformation:         Transformation of the physical object in the
                                world.
    Output:
        physical_object: The physical object."""

__author__ = "Tim Schneider"
__version__ = "2020.10.12"

import rhinoscriptsyntax as rs
import Grasshopper as gh

import sys

ghcompfolder = gh.Folders.DefaultAssemblyFolder
ghsim_path = ghcompfolder + "ghsim"
if ghsim_path not in sys.path:
    sys.path.append(ghsim_path)
try:
    import ghsim
except:
    ghenv.Component.AddRuntimeMessage(gh.Kernel.GH_RuntimeMessageLevel.Error, 
        "Cannot import ghsim. Please ensure that the ghsim.py "
        "module is installed in \"{}\".".format(ghsim_path))
    ghsim = None

if ghsim:
    ok = True
    if physical_object_type is None:
        ok = False
        ghsim.log_error(ghenv, 
            "The \"physical_object_type\" parameter must not be empty.")
    if transformation is None:
        ok = False
        ghsim.log_error(ghenv, 
            "The \"transformation\" parameter must not be empty.")
    
    if ok:
        physical_object = ghsim.PhysicalObject(
            physical_object_type, transformation)
# ---------- end physicalobject ----------
physicalobject_2 = CreatePhysicalObject(physical_object_type=physicalobjecttype_2, transformation=depart_2.TR)  # -> physical_object; inputs transformation: Transform; same code as physicalobject
simulation_time_step_s = Slider(0.1, range=0.001..0.5)
externalsimulator = GhPythonScript(hostname="localhost", port="8000")  # -> simulator
# ---------- externalsimulator: Python ----------
# MIT License
#
# Copyright (c) 2020 Tim Schneider
#
# Permission is hereby granted, free of charge, to any person obtaining a copy
# of this software and associated documentation files (the "Software"), to deal
# in the Software without restriction, including without limitation the rights
# to use, copy, modify, merge, publish, distribute, sublicense, and/or sell
# copies of the Software, and to permit persons to whom the Software is
# furnished to do so, subject to the following conditions:
#
# The above copyright notice and this permission notice shall be included in all
# copies or substantial portions of the Software.
#
# THE SOFTWARE IS PROVIDED "AS IS", WITHOUT WARRANTY OF ANY KIND, EXPRESS OR
# IMPLIED, INCLUDING BUT NOT LIMITED TO THE WARRANTIES OF MERCHANTABILITY,
# FITNESS FOR A PARTICULAR PURPOSE AND NONINFRINGEMENT. IN NO EVENT SHALL THE
# AUTHORS OR COPYRIGHT HOLDERS BE LIABLE FOR ANY CLAIM, DAMAGES OR OTHER
# LIABILITY, WHETHER IN AN ACTION OF CONTRACT, TORT OR OTHERWISE, ARISING FROM,
# OUT OF OR IN CONNECTION WITH THE SOFTWARE OR THE USE OR OTHER DEALINGS IN THE
# SOFTWARE.

"""Creates a simulator configuration for an external simulator.
    Inputs:
        hostname:   The hostname of the external simulator (default: localhost).
        port:       The port of the external simulator (default: 8000).
    Output:
        simulator: The simulator configuration."""

__author__ = "Tim Schneider"
__version__ = "2020.10.12"

import rhinoscriptsyntax as rs
import Grasshopper as gh

import sys

ghcompfolder = gh.Folders.DefaultAssemblyFolder
ghsim_path = ghcompfolder + "ghsim"
if ghsim_path not in sys.path:
    sys.path.append(ghsim_path)
try:
    import ghsim
except:
    ghenv.Component.AddRuntimeMessage(gh.Kernel.GH_RuntimeMessageLevel.Error, 
        "Cannot import ghsim. Please ensure that the ghsim.py "
        "module is installed in \"{}\".".format(ghsim_path))
    ghsim = None

if ghsim:
    if hostname is None:
        hostname = "localhost"
    if port is None:
        port = 8000
    
    simulator = ghsim.Simulator(hostname, int(port))
# ---------- end externalsimulator ----------
int = Integer(20)
merge_10 = Merge(Data1=physicalobject, Data2=physicalobject_2)
simulation = Simulation(
    physical_objects=merge_10,
    simulator=externalsimulator,
    enabled=Toggle(True),
    simulation_time_s=Slider(5, range=0..15),
    simulation_time_step_s=simulation_time_step_s,
    simulation_substeps=int)  # -> simulation_result; inputs physical_objects: list, enabled: Boolean, simulation_substeps: Int32
# ---------- simulation: Python ----------
# MIT License
#
# Copyright (c) 2020 Tim Schneider
#
# Permission is hereby granted, free of charge, to any person obtaining a copy
# of this software and associated documentation files (the "Software"), to deal
# in the Software without restriction, including without limitation the rights
# to use, copy, modify, merge, publish, distribute, sublicense, and/or sell
# copies of the Software, and to permit persons to whom the Software is
# furnished to do so, subject to the following conditions:
#
# The above copyright notice and this permission notice shall be included in all
# copies or substantial portions of the Software.
#
# THE SOFTWARE IS PROVIDED "AS IS", WITHOUT WARRANTY OF ANY KIND, EXPRESS OR
# IMPLIED, INCLUDING BUT NOT LIMITED TO THE WARRANTIES OF MERCHANTABILITY,
# FITNESS FOR A PARTICULAR PURPOSE AND NONINFRINGEMENT. IN NO EVENT SHALL THE
# AUTHORS OR COPYRIGHT HOLDERS BE LIABLE FOR ANY CLAIM, DAMAGES OR OTHER
# LIABILITY, WHETHER IN AN ACTION OF CONTRACT, TORT OR OTHERWISE, ARISING FROM,
# OUT OF OR IN CONNECTION WITH THE SOFTWARE OR THE USE OR OTHER DEALINGS IN THE
# SOFTWARE.

"""Simulates the behavior of the given physical objects.
    Inputs:
        physical_objects:       The physical objects to simulate.
        simulator:              The simulator configuration.
        enabled:                Set this to false to disable the simulation.
        simulation_time_s:      Total time of the simulation in seconds (default
                                10s).
        simulation_time_step_s: Time step of the simulator in seconds (default
                                0.1s).
        real_time_factor:       Real time factor of the simulation. Setting e.g.
                                0.5 here will cause the simulation to run in
                                half of real time speed. Note that this
                                parameter is ignored if the simulation server
                                was not launched with the "-v" flag.
        simulation_substeps:    Further subdivide the simulator steps by this
                                number (default 20). This will trade performance
                                over accuracy.
        ground_plane_pos:       Position of the ground plane (z coordinates)
                                (default: lowest point of all meshes -3mm).
    Output:
        simulation_result:  The results of the simulation as a list of 
                            simulation states (one for each time step)."""

__author__ = "Tim Schneider"
__version__ = "2020.10.12"

import rhinoscriptsyntax as rs
import Grasshopper as gh

import sys

ghcompfolder = gh.Folders.DefaultAssemblyFolder
ghsim_path = ghcompfolder + "ghsim"
if ghsim_path not in sys.path:
    sys.path.append(ghsim_path)
try:
    import ghsim
except:
    ghenv.Component.AddRuntimeMessage(gh.Kernel.GH_RuntimeMessageLevel.Error, 
        "Cannot import ghsim. Please ensure that the ghsim.py "
        "module is installed in \"{}\".".format(ghsim_path))
    ghsim = None

if ghsim:
    if enabled:
        ok = True
        if simulation_time_s is None:
            simulation_time_s = 5.0
        if simulation_time_step_s is None:
            simulation_time_step_s = 0.1
        if simulation_substeps is None:
            simulation_substeps = 20
        if physical_objects is None:
            ok = False
            ghsim.log_error(ghenv, 
                "The \"physical_objects\" parameter must not be empty.")
        if simulator is None:
            ok = False
            ghsim.log_error(ghenv, "The \"simulator\" parameter must not be empty.")
        if ok:
            try:
                with ghsim.SimulatorConnection(simulator) as conn:
                    simulation_result = conn.simulate(physical_objects, 
                        simulation_time_s, simulation_time_step_s, 
                        simulation_substeps, real_time_factor, ground_plane_pos)
            except Exception as e:
                ghsim.log_error(ghenv, str(e))
# ---------- end simulation ----------
time_s = Slider(0, range=0..15)
simulationstateat = RetrieveSimulationStateAt(simulation_results=simulation, time_s=time_s)  # -> simulation_state; inputs simulation_results: list
# ---------- simulationstateat: Python ----------
# MIT License
#
# Copyright (c) 2020 Tim Schneider
#
# Permission is hereby granted, free of charge, to any person obtaining a copy
# of this software and associated documentation files (the "Software"), to deal
# in the Software without restriction, including without limitation the rights
# to use, copy, modify, merge, publish, distribute, sublicense, and/or sell
# copies of the Software, and to permit persons to whom the Software is
# furnished to do so, subject to the following conditions:
#
# The above copyright notice and this permission notice shall be included in all
# copies or substantial portions of the Software.
#
# THE SOFTWARE IS PROVIDED "AS IS", WITHOUT WARRANTY OF ANY KIND, EXPRESS OR
# IMPLIED, INCLUDING BUT NOT LIMITED TO THE WARRANTIES OF MERCHANTABILITY,
# FITNESS FOR A PARTICULAR PURPOSE AND NONINFRINGEMENT. IN NO EVENT SHALL THE
# AUTHORS OR COPYRIGHT HOLDERS BE LIABLE FOR ANY CLAIM, DAMAGES OR OTHER
# LIABILITY, WHETHER IN AN ACTION OF CONTRACT, TORT OR OTHERWISE, ARISING FROM,
# OUT OF OR IN CONNECTION WITH THE SOFTWARE OR THE USE OR OTHER DEALINGS IN THE
# SOFTWARE.

""" Extracts the state of the simulation at a specific time.
    Inputs:
        simulation_results: Simulation results as produced by the simulator.
        time_s:             Time in seconds at which to extract the state. 
    Output:
        simulation_state: Physical objects of the simulation at the given time."""

__author__ = "Tim Schneider"
__version__ = "2020.10.12"

import rhinoscriptsyntax as rs
import Grasshopper as gh

import sys

import bisect

ghcompfolder = gh.Folders.DefaultAssemblyFolder
ghsim_path = ghcompfolder + "ghsim"
if ghsim_path not in sys.path:
    sys.path.append(ghsim_path)
try:
    import ghsim
except:
    ghenv.Component.AddRuntimeMessage(gh.Kernel.GH_RuntimeMessageLevel.Error, 
        "Cannot import ghsim. Please ensure that the ghsim.py "
        "module is installed in \"{}\".".format(ghsim_path))
    ghsim = None

if ghsim:
    ok = True
    if simulation_results is None:
        ghsim.log_error(ghenv, 
            "The \"simulation_results\" parameter must not be empty.")
        ok = False
    if len(simulation_results) == 0 or simulation_results[0] is None:
        ghsim.log_error(ghenv, 
            "\"simulation_results\" must contain at least one time step.")
        ok = False
    if time_s is None:
        ghsim.log_error(ghenv, "The \"time_s\" parameter must not be empty.")
        ok = False
    
    if ok:
        index = bisect.bisect_left(
            [s.time_s for s in simulation_results], time_s)
        index = min(index, len(simulation_results) - 1)
        simulation_state = simulation_results[index].physical_objects
# ---------- end simulationstateat ----------
unpackphysicalobject = UnpackPhysicalObject(physical_object=simulationstateat)  # -> simplify(convex_geometries), transformation
# ---------- unpackphysicalobject: Python ----------
# MIT License
#
# Copyright (c) 2020 Tim Schneider
#
# Permission is hereby granted, free of charge, to any person obtaining a copy
# of this software and associated documentation files (the "Software"), to deal
# in the Software without restriction, including without limitation the rights
# to use, copy, modify, merge, publish, distribute, sublicense, and/or sell
# copies of the Software, and to permit persons to whom the Software is
# furnished to do so, subject to the following conditions:
#
# The above copyright notice and this permission notice shall be included in all
# copies or substantial portions of the Software.
#
# THE SOFTWARE IS PROVIDED "AS IS", WITHOUT WARRANTY OF ANY KIND, EXPRESS OR
# IMPLIED, INCLUDING BUT NOT LIMITED TO THE WARRANTIES OF MERCHANTABILITY,
# FITNESS FOR A PARTICULAR PURPOSE AND NONINFRINGEMENT. IN NO EVENT SHALL THE
# AUTHORS OR COPYRIGHT HOLDERS BE LIABLE FOR ANY CLAIM, DAMAGES OR OTHER
# LIABILITY, WHETHER IN AN ACTION OF CONTRACT, TORT OR OTHERWISE, ARISING FROM,
# OUT OF OR IN CONNECTION WITH THE SOFTWARE OR THE USE OR OTHER DEALINGS IN THE
# SOFTWARE.

"""Unpacks a physical object into its geometries and transformation.
    Inputs:
        physical_object: Physical object to unpack.
    Output:
        convex_geometries:  Convex geometries of the physical object.
        transformation:     Transformation of the physical object."""

__author__ = "Tim Schneider"
__version__ = "2020.10.12"

import rhinoscriptsyntax as rs
import Grasshopper as gh

import sys

ghcompfolder = gh.Folders.DefaultAssemblyFolder
ghsim_path = ghcompfolder + "ghsim"
if ghsim_path not in sys.path:
    sys.path.append(ghsim_path)
try:
    import ghsim
except:
    ghenv.Component.AddRuntimeMessage(gh.Kernel.GH_RuntimeMessageLevel.Error, 
        "Cannot import ghsim. Please ensure that the ghsim.py "
        "module is installed in \"{}\".".format(ghsim_path))
    ghsim = None

if ghsim:
    if physical_object is None:
        ghsim.log_error(ghenv, 
            "The \"physical_object\" parameter must not be empty.")
    else:
        convex_geometries = physical_object.physical_object_type.convex_geometries
        transformation = physical_object.transformation
# ---------- end unpackphysicalobject ----------
mjoin = MeshJoin(Meshes=unpackphysicalobject.convex_geometries)
transform = Transform(Geometry=flatten(mjoin), Transform=unpackphysicalobject.transformation)
preview_2 = CustomPreview(Geometry=transform, Material=graft(ColourSwatch(SwatchColor=RGB(5, 81, 158))))
